# Dynamo graph Revit to X-frame 3D.dyn (Dynamo 2.0.2.6826)

categories = Categories(index=233)  # graph input
all_elements_of_category = ElementsOfCategory(Category=categories)
categories_2 = Categories(index=33)  # graph input
all_elements_of_category_2 = ElementsOfCategory(Category=categories_2)
categories_3 = Categories(index=9)  # graph input
all_elements_of_category_3 = ElementsOfCategory(Category=categories_3)
categories_4 = Categories(index=19)  # graph input
all_elements_of_category_4 = ElementsOfCategory(Category=categories_4)
xframe3DExportXML = Custom[Xframe3DExportXML](Grids=all_elements_of_category, Analytical_Nodes=all_elements_of_category_2, Analytical_Beams=all_elements_of_category_3, Analytical_Columns=all_elements_of_category_4)  # Export XML-file from Revit

# group: WRITE TO FILE
code_block = CodeBlock { "C:/TEMP/test5.xml"; }
writeText = FileSystem.WriteText(filePath=code_block, text=xframe3DExportXML)

code_block_2 = CodeBlock { 2; 0; }
