# Dynamo graph Xframe3DToRevit.dyn (Dynamo 2.3.0.5885)
# packages: Dyn2Calc.Xframe3D 0.1.2

file_path = Filename("..\..\..\..\Bureaublad\TEMP\1256-5.6 Fundering.xml")  # graph input
xframe3DImportXML = Custom[Xframe3DImportXML](xmlFile=file_path)  # package Dyn2Calc.Xframe3D; Import Xframe3D XML and convert to points, lines and metadata

# group: CREATE BEAMS
family_types = FamilyTypes()  # nothing selected; graph input
byStartPointEndPoint = Line.ByStartPointEndPoint(startPoint=xframe3DImportXML.beamFromNodeNumber, endPoint=xframe3DImportXML.beamToNodeNumber)  # frozen
byTwoPoints = Vector.ByTwoPoints(start=xframe3DImportXML.beamFromNodeNumber, end=xframe3DImportXML.beamToNodeNumber)
ZAxis = Vector.ZAxis()
isParallel = Vector.IsParallel(vector=byTwoPoints, other=ZAxis)
filterByBoolMask = List.FilterByBoolMask(list=xframe3DImportXML.beamProfileName, mask=isParallel)
levels = Levels("00_begane grond")  # graph input
beamByCurve = StructuralFraming.BeamByCurve(curve=filterByBoolMask.out, level=levels)  # unwired: structuralFramingType

beams = Python(IN[0]=filterByBoolMask.out)
# ---------- beams.python (8 lines) ----------
profiles = IN[0]

uniqueprofiles = []
for i in profiles:
    if i not in uniqueprofiles:
        uniqueprofiles.append(i)

OUT = uniqueprofiles
# ----------------------------------------
structural_columns = Python(IN[0]=filterByBoolMask.in)  # same code as beams
family_types_2 = FamilyTypes()  # nothing selected; graph input
family_types_3 = FamilyTypes()  # nothing selected; graph input
create = List.Create(item0=family_types_2, item1=family_types_3)
python_script = Python(IN[0]=filterByBoolMask.in, IN[1]=structural_columns, IN[2]=create)
# ---------- python_script.python (24 lines) ----------
import clr
clr.AddReference('ProtoGeometry')
from Autodesk.DesignScript.Geometry import *
#The inputs to this node will be stored as a list in the IN variables.
dataEnteringNode = IN

input = IN[0]
inputChars = IN[1]
inputNumbers = IN[2]

# define Dictionary with the conversion step
myDict = {}

# fill the dictionary
for x in range(0, len(inputChars)):
    myDict[inputChars[x]] = inputNumbers[x]

# convert each item in the list step by step
output = []
for c in input:
    output.append(myDict.get(c))

#Assign your output to the OUT variable.
OUT = output
# ----------------------------------------
points = List.FilterByBoolMask(list=xframe3DImportXML.beamFromNodeNumber, mask=isParallel)
byPoint = FamilyInstance.ByPoint(familyType=python_script, point=points.in)  # frozen
profiles = List.FilterByBoolMask(list=xframe3DImportXML.beamProfileName, mask=isParallel)
flatten = List.Flatten(list=profiles.in)
dyn2CalcXframe3DGrids = Custom[Dyn2CalcXframe3DGrids](Xframe3DXML_gridX=xframe3DImportXML.gridX, Xframe3DXML_gridXLable=xframe3DImportXML.gridXLable, Xframe3DXML_gridY=xframe3DImportXML.gridY, Xframe3DXML_gridYLable=xframe3DImportXML.gridYLable)  # Create Grids in Revit based on Xframe3DXMLImport
